# Grasshopper definition analysis.gh (Grasshopper 1.0.7)
# plug-ins: Geospatial, Human, Excel

panel = Panel("D:\Code\114_temp\008_CodeCollection\005_java\matsim_preparation\src\main\resources\output_ucl\002\r_global\output_img\output_events_{0}.xlsx")
panel_2 = Panel("D:\Code\114_temp\008_CodeCollection\005_java\matsim_preparation\src\main\resources\output_ucl\002\r_global\output_img\output_events_{0}.xlsx")
file_path = FilePath("D:\Code\114_temp\008_CodeCollection\005_java\matsim_preparation\src\main\resources\output_ucl\002\r_global\output_img\link_counts_32400-36000.xlsx")
format = Format(Format=panel, Culture=127, Data0=Slider(14, range=0..29))
file_path_2 = FilePath("D:\Code\114_temp\008_CodeCollection\005_java\matsim_preparation\src\main\resources\output_ucl\002\r_global\output_img\link_counts.xlsx")
panel_3 = Panel(format)
format_2 = Format(Format=panel_2, Culture=127, Data0=Slider(29, range=0..29))
file_path_3 = FilePath("D:\Code\114_temp\008_CodeCollection\005_java\matsim_preparation\src\main\resources\debug\part_london\buildings.geojson")
panel_4 = Panel(format_2)
excelread = ExcelRead(Start=Toggle(True), FilePath=format)
read_geojson = ReadGeoJSON(File=file_path_3)  # -> Type, Geometry, Keys, Values
list_item = ListItem(List=read_geojson.Values, Index="5", Wrap=True)
list_item_2 = ListItem(List=read_geojson.Values, Index="4", Wrap=True)
excelread_2 = ExcelRead(Start=Toggle(True), FilePath=file_path_2)
cull_index = CullIndex(List=excelread, Indices=0, Wrap=True)
flip_matrix = FlipMatrix(Data=cull_index)
cull_index_2 = CullIndex(List=excelread_2, Indices=0, Wrap=True)
flip_matrix_2 = FlipMatrix(Data=cull_index_2)
data = Data(flatten(read_geojson.Geometry))
c_script = CSharpScript(geo=read_geojson.Geometry, use=list_item, height=list_item_2)  # -> A, B, C; inputs geo: tree of Curve, use: tree of String, height: tree of Double
# ---------- c_script: C# ----------
    DataTree<Curve> res_crv = new DataTree<Curve>();
    DataTree<string> res_use = new DataTree<string>();
    DataTree<double> res_height = new DataTree<double>();
    for (int i = 0; i < use.BranchCount; i++)
    {
      res_crv.Add(geo.Branches[i][0]);
      res_use.Add(Filter(use.Branches[i][0]));
      res_height.Add(height.Branches[i][0]);
    }
    A = res_crv;
    B = res_use;
    C = res_height;
# ---------- c_script: C# additional code ----------
  private string Filter(string str){
    string res = "";
    switch (str)
    {
      case "RETAIL ONLY":
      case "RETAIL WITH OFFICE/RESIDENTIAL ABOVE":
      case "RETAIL - VACANT/DERELICT":
      case "GENERAL COMMERCIAL - MIXED USE":
      case "RECREATION AND LEISURE":
      case "GENERAL COMMERCIAL - MIXED USE - DERELICT":
      case "RETAIL - PETROL STATION":
      case "RETAIL - WITH MORE RECENT EXTENSIONS OF DIFFERENT TYPE CONSTRUCTION/AGE":
        res = "C";
        break;
      case "RESIDENTIAL ONLY":
      case "RESIDENTIAL WITH RETAIL ON GROUND FLOOR":
        res = "R";
        break;
      case "COMMUNITY - INSTITUTIONAL AND COMMUNAL ACCOMMODATION":
        res = "H";
        break;
      case "OFFICE ONLY":
      case "TRANSPORT":
      case "COMMUNITY - HEALTH":
      case "OFFICE WITH RETAIL ON GROUND FLOOR":
      case "COMMUNITY - GOVERNMENTAL (CENTRAL AND LOCAL)":
      case "COMMUNITY - RELIGIOUS":
      case "COMMUNITY - EDUCATIONAL":
      case "COMMUNITY - EMERGENCY SERVICES":
      case "AGRICULTURAL - UNCLASSIFIED":
      case "UNCLASSIFIED":
        res = "O";
        break;
      case "INDUSTRY - MANUFACTURING/PROCESSING":
        res = "M";
        break;
      case "UTILITIES":
        res = "W";
        break;
    }

    return res;
  }
# ---------- end c_script ----------
area = Area(Geometry=c_script.A)  # -> Area, Centroid
list_item_3 = ListItem(List=flip_matrix, Index="10", Wrap=True)  # -> Item, flatten(Item1)
panel_5 = Panel("""function
totalArea
floors""")
list_length = ListLength(List=c_script.A)
list_item_4 = ListItem(List=flip_matrix_2, Index="10", Wrap=True)  # -> Item, flatten(Item1)
ghpython_script = GhPythonScript(x=c_script.C)  # -> a; inputs x: list
# ---------- ghpython_script: Python ----------
import math
res=[]
for i in range(len(x)):
    floor=-1
    if x[i] ==0:
        floor=1
    else:
        floor=math.ceil(x[i]/3.0)
    res.append(floor)
a=res
# ---------- end ghpython_script ----------
series = Series(Start=0, Step=1, Count=list_length)
multiplication = Multiplication(A=area.Area, B=ghpython_script)
c_script_2 = CSharpScript(x=list_item_3.Item)  # -> A; inputs x: tree of String
# ---------- c_script_2: C# usings ----------
using System.Text.RegularExpressions;
# ---------- c_script_2: C# ----------
    int count = x.BranchCount;
    DataTree<string> res = new DataTree<string>();
    var debug = new List<string>();
    for (int i = 0; i < count; i++)
    {
      var branch = x.Branches[i];
      var temp = branch[0];
      string[] spl = temp.Split(new char[] {' ', '(', ')',','}, StringSplitOptions.RemoveEmptyEntries);
      //var spl = Match(temp);
      //debug.Add(parts[1]);
      GH_Path path = new GH_Path(i);
      //res.Add(spl[0], path);
      res.Add(spl[1], path);
      res.Add(spl[2], path);
      res.Add(spl[3], path);
      res.Add(spl[4], path);
    }
    A = res;
# ---------- c_script_2: C# additional code ----------
  private string[] Match(string input){
    string[] parts = input.Split(new char[] {' ', '(', ')'}, StringSplitOptions.RemoveEmptyEntries);
    return parts;
  }
# ---------- end c_script_2 ----------
list_item_5 = ListItem(List=c_script_2, Index=0, Wrap=True)  # -> Item, Item1, Item2, Item3
c_script_3 = CSharpScript(x=list_item_4.Item)  # -> A; inputs x: tree of String; same code as c_script_2
list_item_6 = ListItem(List=c_script_3, Index=0, Wrap=True)  # -> Item, Item1, Item2, Item3
bounds = Bounds(Numbers=list_item_3.Item1)
construct_point = ConstructPoint(XCoordinate=list_item_5.Item, YCoordinate=list_item_5.Item1, ZCoordinate=0)
construct_point_2 = ConstructPoint(XCoordinate=list_item_5.Item2, YCoordinate=list_item_5.Item3, ZCoordinate=0)
merge = Merge(Data1=graft(c_script.B), Data2=graft(multiplication), Data3=graft(ghpython_script))  # -> simplify(Result)
construct_point_3 = ConstructPoint(XCoordinate=list_item_6.Item, YCoordinate=list_item_6.Item1, ZCoordinate=0)
construct_point_4 = ConstructPoint(XCoordinate=list_item_6.Item2, YCoordinate=list_item_6.Item3, ZCoordinate=0)
cross_reference = CrossReference(ListListA=graft(series), ListListB=panel_5, CrossMode=1)  # -> simplify(ListListA), simplify(ListListB)
line = Line(StartPoint=construct_point, EndPoint=construct_point_2)  # -> flatten(Line)
remap_numbers = RemapNumbers(Value=list_item_3.Item1, Source=bounds, Target=Domain(0, 1))  # -> Mapped, Clipped
line_2 = Line(StartPoint=construct_point_3, EndPoint=construct_point_4)  # -> flatten(Line)
gradient = Gradient(
    LowerLimit=0,
    UpperLimit=1,
    Parameter=remap_numbers.Mapped,
    stops=[0: RGB(0, 128, 0), 0.155: RGB(255, 255, 0), 0.606: RGB(255, 0, 0)])
feature_from_polygons = FeatureFromPolygons(Polygons=graft(c_script.A), Keys=cross_reference.ListListB, Values=merge)
join_geojson = JoinGeoJSON(Features=flatten(feature_from_polygons))
panel_6 = Panel("D:\Code\114_temp\008_CodeCollection\005_java\matsim_preparation\src\main\resources\debug\part_london")
custom_preview_lineweights = CustomPreviewLineweights(Geometry=line, Shader=gradient, Thickness=Slider(5, range=0..10), Absolute=False)
custom_preview_lineweights_2 = CustomPreviewLineweights(Geometry=line_2, Shader=ColourSwatch(SwatchColor=RGB(143, 143, 143)), Thickness=Slider(1, range=0..10), Absolute=False)
boolean_toggle = BooleanToggle(False)
write_file = WriteFile(Directory=panel_6, Filename="building.geojson", Data=join_geojson, Run=boolean_toggle, Overwrite=boolean_toggle)
